# Grasshopper definition dla.gh (Grasshopper 1.0.7)

weight = Slider(1.2, range=0.1..2)
n = Slider(1.6, range=0.1..5)
R = Slider(10, range=0..180)
crv = Curve(<curve referenced from the Rhino model>)
pt = Point(Point(0, 0, 0))
_1_ms = Trigger(Interval=-1, TimerInterval=5, Target=python)
python = GhPythonScript(Weight=weight, Angle=R, Go=Toggle(False), Simulation=crv, Seed=pt, Threshold=n)  # -> out, a, b, c; inputs Seed: Point3d
# ---------- python: Python ----------
__author__ = "1ncarnati0n"

import rhinoscriptsyntax as rs
import Rhino.Geometry as rg
import random
import math

# input variables
w = _Weight
go = _Go
crv = _Simulation
seed = _Seed
threshold = _Threshold
angle = _Angle

# sub functions 
def get_random_point(crv):
    # get random point on the circle
    rndm = random.random()
    rndm_point = crv.PointAtNormalizedLength(rndm)
    return rndm_point
    
def get_vector(point_s, point_e):
    # get a translation vector 
    # 01. get a directional vector 
    vector = point_e - point_s
    # 02. unitize the vector
    vector.Unitize()
    # 03. 임의 각도로 벡터 방향변경 
    rndm = random.uniform(math.radians(-angle), math.radians(angle))
    vector.Rotate(rndm, rg.Plane.WorldXY.ZAxis)
    return vector
    
def move_point(point, vector):
    point = point + vector * w # 가중치
    return point
    
def get_distance(point_s, point_e):
    dstnc = point_s.DistanceTo(point_e)
    return dstnc
    
def get_closest_point(point, aggrgt_lst):
    dstnc_lst = [point.DistanceTo(aggrgt) for aggrgt in aggrgt_lst]
    mnmm_dstnc = min(dstnc_lst)
    mnmm_idx = dstnc_lst.index(mnmm_dstnc)
    clsst_point = aggrgt_lst[mnmm_idx]
    return clsst_point
    
def get_segment(point_s, point_e):
    segment = rg.Line(point_s, point_e)
    return segment


# Execute Function
def main():
    if go == False:
        global prtcl
        global aggrgt_lst
        global seg_lst

        prtcl = get_random_point(crv)
        aggrgt_lst = []
        seg_lst = []
        aggrgt_lst.append(seed)
        
    else:
        vector = get_vector(prtcl, seed)
        prtcl = move_point(prtcl, vector)
        
        clsst_point = get_closest_point(prtcl, aggrgt_lst)
        dstnc = get_distance(prtcl, clsst_point) 
        
        if dstnc <= threshold:
            segment = get_segment(prtcl, clsst_point)
            seg_lst.append(segment)
            aggrgt_lst.append(prtcl)
            prtcl = get_random_point(crv)            
        
    return prtcl, aggrgt_lst, seg_lst

# Execute Function
a, b, c = main()
# ---------- end python ----------
pt_2 = Point(python.a)
pt_3 = Point(python.b)
line = Line(python.c)
panel = Panel(pt_2)
panel_2 = Panel(pt_3)
panel_3 = Panel(line)
